# Dynamo graph tests_dynamo_test_runner.DYN (Dynamo 1.2.0.2690)

RPW_GetFilepath = Custom[RPW_GetFilepath]()

# group: Python Tests
file_path = Filename(".\tests_rpw_dynamo.py")
readText = File.ReadText(file_path)
python_script_from_string = PythonStringNode(script=readText, IN[0]=RPW_GetFilepath)
watch = Watch(python_script_from_string)
