# Dynamo graph RPW_DynamoSamples.DYN (Dynamo 1.2.0.2690)

RPW_GetFilepath = Custom[RPW_GetFilepath]()

# group: Selection [ Need Multiple Walls in Model ]
number_slider = DoubleSlider(98.9, range=0..100 step 0.1)
python_script = Python(IN[0]=RPW_GetFilepath, IN[1]=number_slider)
# ---------- python_script.python (17 lines) ----------
import sys
sys.path.append(r'D:\Dropbox\Shared\dev\repos\revitpythonwrapper')

import rpw
walls = rpw.Collector(of_class='Wall')
wall = rpw.Element(walls.first)

min_height = IN[1] # Number Slider

height_param = wall.parameters['Unconnected Height']

filter_rule = rpw.ParameterFilter(height_param.id, greater=min_height)
col = rpw.Collector(of_class='Wall', parameter_filter=filter_rule)

rpw.Selection(col.elements)

OUT = col.elements
# ----------------------------------------
watch = Watch(python_script)

# group: Collector
python_script_2 = Python(IN[0]=RPW_GetFilepath)
# ---------- python_script_2.python (6 lines) ----------
import sys
sys.path.extend(IN[0])

import rpw
col = rpw.Collector(of_category='OST_Levels')
OUT = col.elements
# ----------------------------------------
get_levels = Watch(python_script_2)

# group: Get Level BuiltInParameter
python_script_3 = Python(IN[0]=RPW_GetFilepath)
# ---------- python_script_3.python (9 lines) ----------
import sys
sys.path.extend(IN[0])

from rpw.element import Element
from rpw.collector import Collector
level = Collector(of_category='OST_Levels', is_element=True).first
level = Element(level)
param = level.parameters.builtins['DATUM_TEXT']
OUT = param.value
# ----------------------------------------
get_level_name = Watch(python_script_3)

RPW_GetFilepath_2 = Custom[RPW_GetFilepath]()

# group: Exceptions
parameterNotFound = Python(IN[0]=RPW_GetFilepath_2)
# ---------- parameterNotFound.python (5 lines) ----------
import sys
sys.path.extend(IN[0])
from rpw.exceptions import *

raise RPW_ParameterNotFound('Test', 'Some name')
# ----------------------------------------
wrongStorageType = Python(IN[0]=RPW_GetFilepath_2)
# ---------- wrongStorageType.python (5 lines) ----------
import sys
sys.path.extend(IN[0])
from rpw.exceptions import *

raise RPW_WrongStorageType(str, 3)
# ----------------------------------------
typeError = Python(IN[0]=RPW_GetFilepath_2)
# ---------- typeError.python (6 lines) ----------
import sys
sys.path.extend(IN[0])
from rpw.exceptions import *

raise RPW_TypeError(str, int)
raise RPW_TypeError(str)
# ----------------------------------------
baseException = Python(IN[0]=RPW_GetFilepath_2)
# ---------- baseException.python (5 lines) ----------
import sys
sys.path.extend(IN[0])
from rpw.exceptions import *

raise RPW_Exception('Base Exception Test')
# ----------------------------------------

# group: Parameters [ Need 1 Wall in Model ]
number_slider_2 = DoubleSlider(31.6, range=0..100 step 0.1)
transaction = Python(IN[0]=RPW_GetFilepath, IN[1]=number_slider_2)
# ---------- transaction.python (12 lines) ----------
import sys
sys.path.extend(IN[0])

from rpw.collector import Collector
from rpw.element import Element
from rpw.transaction import Transaction

wall = Collector(of_class='Wall').first
wall = Element(wall)

with Transaction('Add Comment'):
	wall.parameters['Comments'].value = IN[1]
# ----------------------------------------
add_parameter_to_element = Watch(transaction)

# group: Revit Version
python_script_4 = Python(IN[0]=RPW_GetFilepath)
# ---------- python_script_4.python (6 lines) ----------
import sys
sys.path.extend(IN[0])

from rpw import version

OUT = version
# ----------------------------------------
revit_version = Watch(python_script_4)
