# Dynamo graph RPW_GettingStarted.dyn (Dynamo 1.2.0.2690)

RPW_GetFilepath = Custom[RPW_GetFilepath]()
python_script = Python(IN[0]=RPW_GetFilepath)
# ---------- python_script.python (6 lines) ----------
path = IN[0]
import sys
sys.path = path

import rpw
OUT = rpw.Collector(of_category='OST_Levels').elements
# ----------------------------------------
watch = Watch(python_script)
