# Dynamo custom node RPW_GetFilepath.dyf (Dynamo 1.2.0.2690)
# category: Python

python_script = Python()  # unwired: IN[0]
# ---------- python_script.python (21 lines) ----------
""" 
RevitPythonWrapper
==================
Gui Talarico
"""

import clr
import sys
sys.path.append(r'C:\Program Files (x86)\IronPython 2.7\Lib')
import os

appdata_path = os.getenv('appdata')
dynamo_path = os.path.join(appdata_path, 'Dynamo')

folders = []
for root, subfolders, files in os.walk(dynamo_path):
	if 'RevitPythonWrapper' in subfolders:
		module_path = os.path.join(root, 'extra')
		folders.append(root)

OUT = folders or 'Could Not Find Module. Make sure it\'s installed properly'
# ----------------------------------------
Output = Output(python_script)  # ""
