# Dynamo graph dynamo_samples.DYN (Dynamo 1.2.0.2690)

# group: Selection
number_slider = DoubleSlider(9.3, range=0..100 step 0.1)
python_script = Python(IN[0]=number_slider)
# ---------- python_script.python (17 lines) ----------
import sys
sys.path.append(r'D:\Dropbox\Shared\dev\repos\revitpythonwrapper')

import rpw
walls = rpw.Collector(of_class='Wall')
wall = rpw.Element(walls.first)

min_height = IN[0] # Number Slider

height_param = wall.parameters['Unconnected Height']

filter_rule = rpw.ParameterFilter(height_param.id, greater=min_height)
col = rpw.Collector(of_class='Wall', parameter_filter=filter_rule)

rpw.Selection(col.elements)

OUT = col.elements
# ----------------------------------------
watch = Watch(python_script)

code_block = CodeBlock()
# ---------- code_block.designscript (8 lines) ----------
"
import sys
sys.path.append(r'D:\Dropbox\Shared\dev\repos\revitpythonwrapper')

from rpw.collector import Collector
col = Collector(of_class='Wall')
OUT = col.first
";
# ----------------------------------------
python_script_2 = Python()  # unwired: IN[0]
# ---------- python_script_2.python (6 lines) ----------
import sys
sys.path.append(r'D:\Dropbox\Shared\dev\repos\revitpythonwrapper')

from rpw.collector import Collector
col = Collector(of_category='OST_Levels')
OUT = col.first
# ----------------------------------------
watch_2 = Watch(python_script_2)
code_block_2 = CodeBlock()
# ---------- code_block_2.designscript (8 lines) ----------
"
import sys
sys.path.append(r'D:\Dropbox\Shared\dev\repos\revitpythonwrapper')

from rpw.collector import Collector
col = Collector(of_category='OST_Levels')
OUT = col.first
";
# ----------------------------------------
python_script_3 = Python()  # unwired: IN[0]
# ---------- python_script_3.python (9 lines) ----------
import sys
sys.path.append(r'D:\Dropbox\Shared\dev\repos\revitpythonwrapper')

from rpw.element import Element
from rpw.collector import Collector
level = Collector(of_category='OST_Levels', is_element=True).first
level = Element(level)
param = level.parameters.builtins['DATUM_TEXT']
OUT = param.value
# ----------------------------------------
watch_3 = Watch(python_script_3)
code_block_3 = CodeBlock()
# ---------- code_block_3.designscript (11 lines) ----------
"
import sys
sys.path.append(r'D:\Dropbox\Shared\dev\repos\revitpythonwrapper')

from rpw.element import Element
from rpw.collector import Collector
level = Collector(of_category='OST_Levels', is_element=True).first
level = Element(level)
param = level.parameters.builtins['DATUM_TEXT']
OUT = param.value
";
# ----------------------------------------

# group: Exceptions
parameterNotFound = Python()  # unwired: IN[0]
# ---------- parameterNotFound.python (5 lines) ----------
import sys
sys.path.append(r'D:\Dropbox\Shared\dev\repos\revitpythonwrapper')
from rpw.exceptions import *

raise RPW_ParameterNotFound('Test', 'Some name')
# ----------------------------------------
wrongStorageType = Python()  # unwired: IN[0]
# ---------- wrongStorageType.python (5 lines) ----------
import sys
sys.path.append(r'D:\Dropbox\Shared\dev\repos\revitpythonwrapper')
from rpw.exceptions import *

raise RPW_WrongStorageType(str, 3)
# ----------------------------------------
typeError = Python()  # unwired: IN[0]
# ---------- typeError.python (6 lines) ----------
import sys
sys.path.append(r'D:\Dropbox\Shared\dev\repos\revitpythonwrapper')
from rpw.exceptions import *

raise RPW_TypeError(str, int)
raise RPW_TypeError(str)
# ----------------------------------------
baseException = Python()  # unwired: IN[0]
# ---------- baseException.python (5 lines) ----------
import sys
sys.path.append(r'D:\Dropbox\Shared\dev\repos\revitpythonwrapper')
from rpw.exceptions import *

raise RPW_Exception('Base Exception Test')
# ----------------------------------------

python_script_4 = Python()  # unwired: IN[0]
# ---------- python_script_4.python (6 lines) ----------
import sys
sys.path.append(r'D:\Dropbox\Shared\dev\repos\revitpythonwrapper')

from rpw import version

OUT = version
# ----------------------------------------
watch_4 = Watch(python_script_4)
number_slider_2 = DoubleSlider(31.6, range=0..100 step 0.1)
transaction = Python(IN[0]=number_slider_2)
# ---------- transaction.python (12 lines) ----------
import sys
sys.path.append(r'D:\Dropbox\Shared\dev\repos\revitpythonwrapper')

from rpw.collector import Collector
from rpw.element import Element
from rpw.transaction import Transaction

wall = Collector(of_class='Wall').first
wall = Element(wall)

with Transaction('Add Comment'):
	wall.parameters['Comments'].value = IN[0]
# ----------------------------------------
watch_5 = Watch(transaction)
