# Dynamo graph tests_DynamoTestRunner.dyn (Dynamo 1.2.0.2690)

local_development_path = Directory("D:\Dropbox\Shared\dev\repos\revitpythonwrapper")

# group: Python Tests
file_path = Filename(".\tests_rpw_dynamo.py")
readText = File.ReadText(file_path)
python_script_from_string = PythonStringNode(script=readText, IN[0]=local_development_path)
watch = Watch(python_script_from_string)
